# Dynamo graph ImportSolidworks.dyn (Dynamo 2.6.1.8786)

boolean = BoolSelector(true)
file_path = Filename("..\..\..\..\..\Downloads\System assembly\Pumping system.SAT")  # graph input
if_ = If(test=boolean, true=file_path, false=file_path)
importFromSAT = Geometry.ImportFromSAT(file=if_)
scale_factor = CodeBlock { feet = 3.28084; inch = 39.3701; }
code_block = CodeBlock(factor=scale_factor.feet) { factor; }
scale = Geometry.Scale(geometry=importFromSAT, xamount=code_block, yamount=code_block, zamount=code_block)
origin = Point.Origin()
XAxis = Vector.XAxis()
code_block_2 = CodeBlock { 90; }
rotate = Geometry.Rotate(geometry=scale, origin=origin, axis=XAxis, degrees=code_block_2)
byUnion = Solid.ByUnion(solids=rotate)
fileName = FileSystem.FileName(path=file_path)
code_block_3 = CodeBlock(name=fileName) { name; }
categories = Categories("OST_GenericModel")
file_path_2 = Filename("..\..\..\..\..\..\..\ProgramData\Autodesk\RVT 2018\Family Templates\English_I\Generic Model.rft")
code_block_4 = CodeBlock { "Default"; }
byName = Material.ByName(name=code_block_4)
byGeometry = FamilyType.ByGeometry(solidGeometry=byUnion, name=code_block_3, category=categories, templatePath=file_path_2, material=byName)
end = Revit.Transaction.Transaction.End(input=byGeometry)  # graph output
